# Grasshopper definition L2.gh (Grasshopper 1.0.8)

amount_of_sides = Slider(6, range=0..10)
top_width = Slider(70, range=0..200)
base_width = Slider(76, range=0..200)
height = Slider(190, range=0..500)
center_width = Slider(86, range=0..200)
shape_spacing = Slider(25, range=0..200)
amount_of_slices = Slider(9, range=0..20)
polygon = Polygon(Plane=PlaneXY(0, 0, 0), Radius=base_width, Segments=amount_of_sides, FilletRadius=0)  # -> Polygon, Length
vec = VectorXYZ(XComponent=0, YComponent=0, ZComponent=height)  # -> Vector, Length
polygon_2 = Polygon(Plane=PlaneXY(0, 0, 0), Radius=top_width, Segments=amount_of_sides, FilletRadius=0)  # -> Polygon, Length
polygon_3 = Polygon(Plane=PlaneXY(0, 0, 0), Radius=center_width, Segments=amount_of_sides, FilletRadius=0)  # -> Polygon, Length
vec_2 = VectorXYZ(XComponent=0, YComponent=0, ZComponent=shape_spacing)  # -> Vector, Length
vec_3 = VectorXYZ(XComponent=0, YComponent=0, ZComponent=height)  # -> Vector, Length
vec_4 = VectorXYZ(XComponent=0, YComponent=0, ZComponent=0)  # -> Vector, Length
dom = ConstructDomain(DomainStart=Slider(191, range=0..300), DomainEnd=Slider(1988, range=0..3000))
pt = Point(vec_4.Vector)
pt_2 = Point(vec_3.Vector)
range = Range(Domain=dom, Steps=Slider(9, range=0..20))
move = Move(Geometry=polygon_2.Polygon, Motion=vec.Vector)  # -> Geometry, Transform
move_2 = Move(Geometry=polygon_3.Polygon, Motion=vec_2.Vector)  # -> Geometry, Transform
ln = Line(StartPoint=pt_2, EndPoint=pt)
loft = Loft(
    Curves=[move.Geometry, move_2.Geometry, polygon.Polygon],
    Options={Adjust=False, Closed=False, LoftEnds=0, LoftSimp=0, LoftType=0, Rebuild=10, Refit=0.01})
xy = XYPlane(Origin=Point(0, 0, 0))
xy_2 = XYPlane(Origin=Point(0, 0, 0))
X = UnitX(Factor=range)
twist = Twist(Geometry=loft, Axis=ln, Angle=Slider(1.7, range=0..2.5), Infinite=False, Rigid=False)
bbox = BoundingBox(Content=twist, Plane=PlaneXY(0, 0, 0))  # -> Box, Box_2
debox = DeconstructBox(Box=bbox.Box)  # -> Plane, X, Y, Z
dedomain = DeconstructDomain(Domain=debox.Z)  # -> Start, End
pt_3 = ConstructPoint(XCoordinate=0, YCoordinate=0, ZCoordinate=dedomain.End)
dom_2 = ConstructDomain(DomainStart=Slider(0, range=0..100), DomainEnd=pt_3)
range_2 = Range(Domain=dom_2, Steps=amount_of_slices)
Z = UnitZ(Factor=range_2)
move_3 = Move(Geometry=xy, Motion=Z)  # -> Geometry, Transform
move_4 = Move(Geometry=xy_2, Motion=X)  # -> Geometry, Transform
sec = BrepPlane(Brep=twist, Plane=move_3.Geometry)  # -> flatten(Curves), Points
c_duplicate = DuplicateContent(Content=twist)
orient = Orient(Geometry=sec.Curves, Source=move_3.Geometry, Target=move_4.Geometry)  # -> Geometry, Transform
scale_nu = ScaleNU(Geometry=c_duplicate, Plane=PlaneXY(0, 0, 0), ScaleX=Slider(0.9, range=0..1), ScaleY=Slider(0.9, range=0..1), ScaleZ=1)  # -> Geometry, Transform
sec_2 = BrepPlane(Brep=scale_nu.Geometry, Plane=move_3.Geometry)  # -> flatten(Curves), Points
orient_2 = Orient(Geometry=sec_2.Curves, Source=move_3.Geometry, Target=move_4.Geometry)  # -> Geometry, Transform
panel = Panel(sec_2.Curves)
lng = ListLength(List=orient_2.Geometry)

boundary = BoundarySurfaces(Edges=[orient_2.Geometry, orient.Geometry])
explode = Explode(Curve=orient_2.Geometry, Recursive=True)  # -> Segments, Vertices
number_slider = Slider(4, range=0..10)
end = EndPoints(Curve=explode.Segments)  # -> Start, End
series = Series(Start=Slider(1, range=0..1), Step=1, Count=lng)
item = ListItem(List=end.Start, Index=Slider(3, range=0..10), Wrap=True)  # -> flatten(Item)
vec_5 = VectorXYZ(XComponent=number_slider, YComponent=number_slider, ZComponent=0)  # -> Vector, Length
addition = Addition(A=item, B=vec_5.Vector)
ln_2 = Line(StartPoint=item, EndPoint=addition)
textsrf = TextOnSurface(
    Text=series,
    Font="Sans Bold:no Italic:no",
    Height=Slider(2.5, range=0..5),
    Depth=Slider(0, range=0..100),
    BaseLine=ln_2,
    BaseSurface=boundary)  # -> flatten(Symbols)

merge = Merge(Data1=orient_2.Geometry, Data2=orient.Geometry, Data3=textsrf)
