# Grasshopper definition M3_chair.gh (Grasshopper 1.0.8)

joint_distance = Slider(2.2, range=0..10)
amount_of_curve = Slider(1.9, range=0..5)
legs_distance = Slider(3.1, range=0..10)
chair_height = Slider(7.41, range=0..10)
negate_value = Slider(-1, range=-1..10)
half = Slider(0.5, range=0..1)
chair_leg_thickness = Slider(0.6, range=0..10)
chair_back_width = Slider(10, range=0..10)
extrusion_width = Slider(0.77, range=0..10)
seat_length = Slider(10, range=0..10)
chair_back_height = Slider(8.6, range=0..10)
seat_width = Slider(10, range=0..10)
idx_4 = Slider(3, range=0..10)
idx_2 = Slider(1, range=0..1)
idx_3 = Slider(2, range=0..10)
idx_1 = Slider(0, range=0..100)
vec = VectorXYZ(XComponent=Slider(1.35, range=0..20), YComponent=0, ZComponent=chair_height)  # -> Vector, Length
vec_2 = VectorXYZ(XComponent=Slider(1.4, range=0..20), YComponent=0, ZComponent=chair_height)  # -> Vector, Length
yz = YZPlane(Origin=vec.Vector)
chair_back = Rectangle(Plane=yz, XSize=chair_back_width, YSize=chair_back_height, Radius=amount_of_curve)  # -> Rectangle, Length
boundary = BoundarySurfaces(Edges=chair_back.Rectangle)
xy = XYPlane(Origin=vec_2.Vector)
chair_seat = Rectangle(Plane=xy, XSize=seat_length, YSize=seat_width, Radius=0)  # -> Rectangle, Length
explode = Explode(Curve=chair_seat.Rectangle, Recursive=True)  # -> Segments, Vertices
boundary_2 = BoundarySurfaces(Edges=chair_seat.Rectangle)
vec_3 = VectorXYZ(XComponent=extrusion_width, YComponent=0, ZComponent=0)  # -> Vector, Length
vec_4 = VectorXYZ(XComponent=0, YComponent=0, ZComponent=extrusion_width)  # -> Vector, Length
item = ListItem(List=explode.Vertices, Index=idx_2, Wrap=True)
item_2 = ListItem(List=explode.Vertices, Index=idx_3, Wrap=True)
item_3 = ListItem(List=explode.Vertices, Index=idx_1, Wrap=True)
item_4 = ListItem(List=explode.Vertices, Index=idx_4, Wrap=True)
chair_back_extrude = Extrude(Base=boundary, Direction=vec_3.Vector)
chair_seat_extrude = Extrude(Base=boundary_2, Direction=vec_4.Vector)
pdecon = Deconstruct(Point=item_3)  # -> XComponent, YComponent, ZComponent
pdecon_2 = Deconstruct(Point=item)  # -> XComponent, YComponent, ZComponent
pdecon_3 = Deconstruct(Point=item_2)  # -> XComponent, YComponent, ZComponent
pdecon_4 = Deconstruct(Point=item_4)  # -> XComponent, YComponent, ZComponent
vec_5 = VectorXYZ(XComponent=0, YComponent=0, ZComponent=Slider(0.7, range=0..10))  # -> Vector, Length
multiplication = Multiplication(A=pdecon_2.XComponent, B=half)
pt = ConstructPoint(XCoordinate=multiplication, YCoordinate=pdecon.YComponent, ZCoordinate=pdecon.ZComponent)
cir = Circle(Plane=[item_3, item, pt], Radius=chair_leg_thickness)
multiplication_2 = Multiplication(A=pdecon_3.XComponent, B=half)
pt_2 = ConstructPoint(XCoordinate=multiplication_2, YCoordinate=pdecon_3.YComponent, ZCoordinate=pdecon_3.ZComponent)
cir_2 = Circle(Plane=[item_2, item_4, pt_2], Radius=chair_leg_thickness)
multiplication_3 = Multiplication(A=legs_distance, B=negate_value)
vec_6 = VectorXYZ(XComponent=0, YComponent=legs_distance, ZComponent=0)  # -> Vector, Length
vec_7 = VectorXYZ(XComponent=0, YComponent=multiplication_3, ZComponent=0)  # -> Vector, Length
pdecon_5 = Deconstruct(Point=pt)  # -> XComponent, YComponent, ZComponent
pdecon_6 = Deconstruct(Point=pt_2)  # -> XComponent, YComponent, ZComponent
pt_3 = ConstructPoint(XCoordinate=pdecon_3.XComponent, YCoordinate=pdecon_3.YComponent, ZCoordinate=0)
pt_4 = ConstructPoint(XCoordinate=pdecon_5.XComponent, YCoordinate=pdecon_5.YComponent, ZCoordinate=0)
pt_5 = ConstructPoint(XCoordinate=pdecon_2.XComponent, YCoordinate=pdecon_2.YComponent, ZCoordinate=0)
pt_6 = ConstructPoint(XCoordinate=pdecon_4.XComponent, YCoordinate=pdecon_4.YComponent, ZCoordinate=0)
pt_7 = ConstructPoint(XCoordinate=pdecon.XComponent, YCoordinate=pdecon.YComponent, ZCoordinate=0)
pt_8 = ConstructPoint(XCoordinate=pdecon_6.XComponent, YCoordinate=pdecon_6.YComponent, ZCoordinate=0)
move = Move(Geometry=[pt_7, pt_4, pt_5], Motion=vec_7.Vector)  # -> Geometry, Transform
move_2 = Move(Geometry=[pt_3, pt_8, pt_6], Motion=vec_6.Vector)  # -> Geometry, Transform
item_5 = ListItem(List=move.Geometry, Index=idx_3, Wrap=True)
item_6 = ListItem(List=move_2.Geometry, Index=idx_3, Wrap=True)
item_7 = ListItem(List=move.Geometry, Index=idx_1, Wrap=True)
item_8 = ListItem(List=move.Geometry, Index=idx_2, Wrap=True)
item_9 = ListItem(List=move_2.Geometry, Index=idx_2, Wrap=True)
item_10 = ListItem(List=move_2.Geometry, Index=idx_1, Wrap=True)
pt_9 = Point([item_5, item])
pt_10 = Point(item_8)
pt_11 = Point(item_9)
pt_12 = Point(item_6)
pt_13 = Point(item_7)
pt_14 = Point(item_10)
avr = Average(Input=[pt, pt_10])
avr_2 = Average(Input=pt_9)
avr_3 = Average(Input=[item_3, pt_13])
avr_4 = Average(Input=[pt_12, item_4])
avr_5 = Average(Input=[item_2, pt_14])
avr_6 = Average(Input=[pt_11, pt_2])
multiplication_4 = Multiplication(A=negate_value, B=joint_distance)
vec_8 = VectorXYZ(XComponent=0, YComponent=joint_distance, ZComponent=0)  # -> Vector, Length
vec_9 = VectorXYZ(XComponent=0, YComponent=multiplication_4, ZComponent=0)  # -> Vector, Length
move_3 = Move(Geometry=[avr_3, avr, avr_2], Motion=vec_9.Vector)  # -> Geometry, Transform
move_4 = Move(Geometry=[avr_5, avr_6, avr_4], Motion=vec_8.Vector)  # -> Geometry, Transform
item_11 = ListItem(List=move_3.Geometry, Index=idx_3, Wrap=True)
item_12 = ListItem(List=move_3.Geometry, Index=idx_1, Wrap=True)
item_13 = ListItem(List=move_3.Geometry, Index=idx_2, Wrap=True)
item_14 = ListItem(List=move_4.Geometry, Index=0, Wrap=True)
item_15 = ListItem(List=move_4.Geometry, Index=idx_3, Wrap=True)
item_16 = ListItem(List=move_4.Geometry, Index=idx_2, Wrap=True)
cir_3 = Circle(Plane=[item_14, item_16, item_15], Radius=chair_leg_thickness)
cir_4 = Circle(Plane=[item_12, item_11, item_13], Radius=chair_leg_thickness)
vec2pt = Vector2Pt(PointA=item_2, PointB=item_14, Unitize=False)  # -> Vector, Length
vec2pt_2 = Vector2Pt(PointA=item_12, PointB=pt_13, Unitize=False)  # -> Vector, Length
vec2pt_3 = Vector2Pt(PointA=item_3, PointB=item_12, Unitize=False)  # -> Vector, Length
vec2pt_4 = Vector2Pt(PointA=item_14, PointB=pt_14, Unitize=False)  # -> Vector, Length
extr = Extrude(Base=cir_2, Direction=vec2pt.Vector)
extr_2 = Extrude(Base=cir_3, Direction=vec2pt_4.Vector)
extr_3 = Extrude(Base=cir, Direction=vec2pt_3.Vector)
extr_4 = Extrude(Base=cir_4, Direction=vec2pt_2.Vector)
extr_5 = Extrude(Base=[cir_2, cir], Direction=vec_5.Vector)
cap = CapHoles(Brep=[extr, extr_3, extr_4, extr_2])
cap_2 = CapHoles(Brep=extr_5)
sunion = SolidUnion(Breps=[cap_2, cap, chair_seat_extrude, chair_back_extrude])  # -> flatten(Result)
panel = Panel(sunion)
